# Dynamo graph 01.dyn (Dynamo 2.17.0.3472)
# packages: Rhythm 2023.4.2024

categories = Categories("OST_Floors")
all_elements_of_category = ElementsOfCategory(Category=categories)
code_block = CodeBlock { "Comments"; }
code_block_2 = CodeBlock { "Type Mark"; }
ʳʰʸᵗʰᵐ_elements = Rhythm.Revit.Elements.Elements.GetParameterValueByNameTypeOrInstance(element=all_elements_of_category, parameterName=code_block_2)
code_block_3 = CodeBlock { "Level"; }
ʳʰʸᵗʰᵐ_elements_2 = Rhythm.Revit.Elements.Elements.GetParameterValueByNameTypeOrInstance(element=all_elements_of_category, parameterName=code_block_3)
name = Level.Name(level=ʳʰʸᵗʰᵐ_elements_2)
add = ʳʰʸᵗʰᵐ_elements + name
setParameterByName = Element.SetParameterByName(element=all_elements_of_category, parameterName=code_block, value=add)
